# Dynamo graph ENVR_060320_DWGtoCurve_.dyn (Dynamo 1.3.3.4111)

select_model_elements = DSModelElementsSelection()  # 1 picked in the model
layerNames = CAD.LayerNames(select_model_elements)
bySelection = Custom[Springs.Filter.BySelection](list=layerNames)  # Check the items that you'd like to filter in. Unchecked items will be sent to the out list. The optional names input will override the object representation.
filterByBoolMask = List.FilterByBoolMask(list=layerNames, mask=bySelection)
curvesFromCADLayers = CAD.CurvesFromCADLayers(select_model_elements, filterByBoolMask.in)
integer_slider = IntegerSlider(3100, range=400..4000 step 100)
levels = Levels("GROUND FLOOR")
wall_types = WallTypes("M1.0-Brick Cavity-270(110BK-50CV-110BK_StandAlone")
byCurveAndHeight = Wall.ByCurveAndHeight(curve=curvesFromCADLayers, height=integer_slider, level=levels, wallType=wall_types)
reportInstances = CAD.ReportInstances()
